# Grasshopper definition assignment3_rhino.gh (Grasshopper 1.0.7)
# Copyright: Co-de-iT

# ---- group: foundation / height of ceiling (for living rooms)
Z = UnitZ(Factor=Slider(9, range=0..10))

# ---- group: foundation / height of ceiling (for roofs)
Z_2 = UnitZ(Factor=Slider(9, range=0..20))

# ---- group: foundation / center pt
pt = ConstructPoint(XCoordinate=0, YCoordinate=0, ZCoordinate=0)

# ---- group: centre pt
pt_2 = Point(pt)

# ---- group: foundation / lift
number_slider = Slider(30, range=0..300)
number_slider_2 = Slider(6, range=0..100)
number_slider_3 = Slider(112, range=0..150)

# ---- group: foundation
xy = XYPlane(Origin=pt)
neg = Negative(Value=number_slider)

# ---- group: foundation / circle size
number_slider_4 = Slider(28, range=0..200)
number_slider_5 = Slider(6, range=0..10)
cir = Circle(Plane=xy, Radius=number_slider_4)

# ---- group: foundation / lift (continued)
Z_3 = UnitZ(Factor=neg)

# ---- group: foundation / divide circle
divide = DivideCurve(Curve=cir, Count=number_slider_5, Kinks=False)  # -> Points, Tangents, Parameters

# ---- group: foundation / vector display
vec2pt = Vector2Pt(PointA=pt, PointB=divide.Points, Unitize=False)  # -> Vector, Length
amp = Amplitude(Vector=vec2pt.Vector, Amplitude=1)
vdis = VectorDisplay(Anchor=divide.Points, Vector=amp)

# ---- group: key dimensions in rectangle bedrooms / internal ground pt
pt_3 = Point(divide.Points)

# ---- group: key dimensions in rectangle bedrooms / external ground floor pts
move = Move(Geometry=pt_3, Motion=vec2pt.Vector)  # -> Geometry, Transform
pt_4 = Point(move.Geometry)

# ---- group: key dimensions in rectangle bedrooms / external roof floor pts
Z_4 = UnitZ(Factor=Slider(9, range=0..10))
move_2 = Move(Geometry=pt_4, Motion=Z_4)  # -> Geometry, Transform
pt_5 = Point(move_2.Geometry)

# ---- group: key dimensions in rectangle bedrooms / internal roof pts
Z_5 = UnitZ(Factor=Slider(9, range=0..100))
move_3 = Move(Geometry=pt_3, Motion=Z_5)  # -> Geometry, Transform
pt_6 = Point(move_3.Geometry)

# ---- group: portal room
cyl = Cylinder(Base=pt, Radius=number_slider_4, Length=Slider(15, range=0..100))
cap = CapHoles(Brep=cyl)
brep = Brep(cap)
Z_6 = UnitZ(Factor=Slider(72, range=0..100))
move_4 = Move(Geometry=brep, Motion=Z_6)  # -> Geometry, Transform
brep_2 = Brep(move_4.Geometry)

# ---- group: portal doorways
srf4pt = _4PointSurface(CornerA=pt_3, CornerB=pt_4, CornerC=pt_5, CornerD=pt_6)
brep_3 = Brep(srf4pt)
boxrec = BoxRectangle(Rectangle=brep_3, Height=Slider(3, range=0..50))
brep_4 = Brep(boxrec)
Z_7 = UnitZ(Factor=Slider(72, range=0..100))
move_5 = Move(Geometry=brep_4, Motion=Z_7)  # -> Geometry, Transform
brep_5 = Brep(move_5.Geometry)

# ---- group: central lift
cyl_2 = Cylinder(Base=Z_3, Radius=number_slider_2, Length=number_slider_3)
cap_2 = CapHoles(Brep=cyl_2)
Z_8 = UnitZ(Factor=Slider(10, range=0..10))
brep_6 = Brep(cap_2)
neg_2 = Negative(Value=Z_8)
move_6 = Move(Geometry=brep_6, Motion=neg_2)  # -> Geometry, Transform

# ---- group: bedrooms / rectangular bedrooms 1st level
srf4pt_2 = _4PointSurface(CornerA=pt_3, CornerB=pt_4, CornerC=pt_5, CornerD=pt_6)
brep_7 = Brep(srf4pt_2)
boxrec_2 = BoxRectangle(Rectangle=brep_7, Height=Slider(7, range=0..50))
brep_8 = Brep(boxrec_2)

# ---- group: living rooms / 1st level
cyl_3 = Cylinder(Base=pt, Radius=number_slider_4, Length=Z)
cap_3 = CapHoles(Brep=cyl_3)
brep_9 = Brep(cap_3)

# ---- group: lower and upper roof / lower roof
cyl_4 = Cylinder(Base=pt, Radius=number_slider_4, Length=Z_2)
cap_4 = CapHoles(Brep=cyl_4)
Z_9 = UnitZ(Factor=Slider(54, range=0..100))
brep_10 = Brep(cap_4)
move_7 = Move(Geometry=brep_10, Motion=Z_9)  # -> Geometry, Transform

# ---- group: living rooms / 2nd level
Z_10 = UnitZ(Factor=Slider(9, range=0..10))
move_8 = Move(Geometry=brep_9, Motion=Z_10)  # -> Geometry, Transform

# ---- group: bedrooms / rectangle bedrooms 2nd level
Z_11 = UnitZ(Factor=Slider(9, range=0..100))
move_9 = Move(Geometry=brep_8, Motion=Z_11)  # -> Geometry, Transform

# ---- group: living rooms / 3rd level
Z_12 = UnitZ(Factor=Slider(9, range=0..10))
move_10 = Move(Geometry=move_8.Geometry, Motion=Z_12)  # -> Geometry, Transform

# ---- group: lower and upper roof / upper roof
Z_13 = UnitZ(Factor=Slider(9, range=0..20))
move_11 = Move(Geometry=move_7.Geometry, Motion=Z_13)  # -> Geometry, Transform

# ---- group: living rooms / 4th level
Z_14 = UnitZ(Factor=Slider(9, range=0..10))
move_12 = Move(Geometry=move_10.Geometry, Motion=Z_14)  # -> Geometry, Transform

# ---- group: bedrooms / rectangle bedrooms 3rd level
Z_15 = UnitZ(Factor=Slider(9, range=0..100))
move_13 = Move(Geometry=move_9.Geometry, Motion=Z_15)  # -> Geometry, Transform

# ---- group: living rooms / 5th level
Z_16 = UnitZ(Factor=Slider(9, range=0..10))
move_14 = Move(Geometry=move_12.Geometry, Motion=Z_16)  # -> Geometry, Transform

# ---- group: bedrooms / rectangle bedrooms 4th level
Z_17 = UnitZ(Factor=Slider(9, range=0..100))
move_15 = Move(Geometry=move_13.Geometry, Motion=Z_17)  # -> Geometry, Transform

# ---- group: living rooms / 6th level
Z_18 = UnitZ(Factor=Slider(9, range=0..10))
move_16 = Move(Geometry=move_14.Geometry, Motion=Z_18)  # -> Geometry, Transform

# ---- group: bedrooms / rectangle bedrooms 5th level
Z_19 = UnitZ(Factor=Slider(9, range=0..100))
move_17 = Move(Geometry=move_15.Geometry, Motion=Z_19)  # -> Geometry, Transform

# ---- group: bedrooms / rectangle bedrooms 6th level
Z_20 = UnitZ(Factor=Slider(9, range=0..100))
move_18 = Move(Geometry=move_17.Geometry, Motion=Z_20)  # -> Geometry, Transform

# ---- group: portal lifts
debrep = DeconstructBrep(Brep=brep_5)  # -> Faces, Edges, Vertices
md_slider = MDSlider(
    SliderMode=0,
    slider_value=Point(1, 0.5203552246, 0.5),
    x_domain=Domain(0, 1),
    y_domain=Domain(0, 1),
    z_domain=Domain(0, 1))
item = ListItem(List=debrep.Faces, Index=Slider(3, range=0..10), Wrap=True)
evaluate_surface = EvaluateSurface(Surface=reparameterize(item), Point=md_slider)  # -> Point, Normal, graft(UDirection), graft(VDirection), Frame
cir_2 = Circle(Plane=evaluate_surface.Point, Radius=Slider(1, range=0..10))
Z_21 = UnitZ(Factor=Slider(9, range=0..10))
extr = Extrude(Base=cir_2, Direction=Z_21)
geo = Geometry(extr)

# ---- group: rotate 90 degrees
merge = Merge(Data1=move_9.Geometry, Data2=move_15.Geometry, Data3=move_18.Geometry)
deg = Degrees(Radians=Slider(44.5, range=0..100))
rotate = Rotate(Geometry=merge, Angle=deg, Plane=PlaneXY(0, 0, 0))  # -> Geometry, Transform
geo_2 = Geometry(rotate.Geometry)

# ----
merge_2 = Merge(Data1=brep_8, Data2=move_13.Geometry, Data3=move_17.Geometry)
geo_3 = Geometry(merge_2)

# ---- group: living rooms
merge_3 = Merge(
    Data1=brep_9,
    Data2=move_8.Geometry,
    Data3=move_10.Geometry,
    Data4=move_12.Geometry,
    Data5=move_14.Geometry,
    Data6=move_16.Geometry)
geo_4 = Geometry(merge_3)

# ---- group: lower and upper roof
merge_4 = Merge(Data1=move_7.Geometry, Data2=move_11.Geometry)
geo_5 = Geometry(merge_4)

# ---- group: bake / bedrooms (even levels)
geo_6 = Geometry(geo_2)

# ---- group: bake / bedrooms (odd levels)
geo_7 = Geometry(geo_3)

# ---- group: bake / living rooms (all levels)
geo_8 = Geometry(geo_4)

# ---- group: bake / lower and upper roof level
geo_9 = Geometry(geo_5)

# ---- group: bake / lift
geo_10 = Geometry(move_6.Geometry)

# ---- group: bake / portal room
geo_11 = Geometry(brep_2)

# ---- group: bake / hallways to portal lifts
geo_12 = Geometry(brep_5)

# ---- group: bake / lift in portal room
geo_13 = Geometry(geo)

# ----
merge_5 = Merge(Data1=geo_6, Data2=geo_7, Data3=geo_8, Data4=geo_9, Data5=geo_10, Data6=geo_11, Data7=geo_12, Data8=geo_13)  # -> flatten(Result)

# ---- group: move building up to start at origin pt
pt_7 = ConstructPoint(XCoordinate=0, YCoordinate=0, ZCoordinate=0)
Z_22 = UnitZ(Factor=Slider(40, range=0..1000))
vec = VectorXYZ(XComponent=pt_7, YComponent=0, ZComponent=Z_22)  # -> Vector, Length
move_19 = Move(Geometry=merge_5, Motion=vec.Vector)  # -> Geometry, Transform

# ----
brep_11 = Brep(simplify(flatten(move_19.Geometry)))
deextrusion_1_1 = DeconstructExtrusion11(brep=brep_11)  # -> doc_2, G, bh_3, bh_4
panel = Panel(deextrusion_1_1.G)
panel_2 = Panel(deextrusion_1_1.bh_3)
panel_3 = Panel("""height
base_height
colour""")
entwine = Entwine(Branch00=deextrusion_1_1.bh_3, Branch01=deextrusion_1_1.bh_4, Branch02="#FFFFFF", FlattenInputs=True)
polyjson_1_1 = PolygonToGeoJSON11(P=deextrusion_1_1.G, K=panel_3, V=entwine)  # -> doc_2, J_2
panel_4 = Panel(polyjson_1_1.J_2)
file_write = FileWrite(content=polyjson_1_1.J_2, file_path="C:\Users\grace\Desktop\FOLDER", T="map (3).geojson", activate=Toggle(True))

# ==== cluster DeconstructExtrusion11: Deconstructs simple extrusions into polylines, heights, and base heights for later use in ‘Polygon to GeoJSON component’.
brep = ClusterInput()
brep_2 = Brep(simplify(graft(brep)))
cap = CapHoles(Brep=brep_2)
debrep = DeconstructBrep(Brep=cap)  # -> Faces, Edges, Vertices
mesh = MeshBrep(
    Brep=cap,
    Settings={GridMaxCount=0, GridMinCount=16, JaggedSeams=False, MaxEdgeLength=0, MinEdgeLength=0.0001, MinTolerance=0, Refine=True, RefineAngle=0, RelativeTolerance=0.65, SimplePlanes=True, Tolerance=0})
area = Area(Geometry=debrep.Faces)  # -> Area, Centroid
mshadow = MeshShadow(Mesh=mesh, Light=Vector(0, 0, -1), Plane=PlaneXY(0, 0, 0))
demesh = DeconstructMesh(Mesh=mesh)  # -> Vertices, Faces, Colours, Normals
pdecon = Deconstruct(Point=area.Centroid)  # -> XComponent, YComponent, ZComponent
pdecon_2 = Deconstruct(Point=demesh.Vertices)  # -> XComponent, YComponent, ZComponent
sort = SortList(Keys=pdecon.ZComponent, ValuesA=debrep.Faces)  # -> Keys, ValuesA
panel = Panel("Deconstructs simple extrusions into polylines, heights, and base heights for later use in ‘Polygon to GeoJSON component’.")
panel_2 = Panel(""" 
INPUTS: 

Brep (B) - Extruded or capped Breps. Must be extruded in the z axis. """)
panel_3 = Panel("""OUTPUTS:

Polyline (Crv)- Projected base polyline of Brep.

Height (H) - Height of Brep.The distance of extrusion. 

Base Height (BH) - The height of the base of the brep from the ground XY Plane.""")
sort_2 = SortList(Keys=pdecon_2.ZComponent)  # -> Keys, ValuesA
item = ListItem(List=sort.ValuesA, Index=0, Wrap=True)
number_slider = Slider(0.1, range=0..0.1)
number_slider_2 = Slider(1, range=0..10)
item_2 = ListItem(List=sort_2.Keys, Index=0, Wrap=True)  # -> Item1, Item
number_slider_3 = Slider(0.5, range=0..1)
panel_4 = Panel("For more documentation visit: github.com/madeleinejohanson/Humpback")
crv = Curve(item)
subtraction = Subtraction(A=item_2.Item1, B=item_2.Item)
topoly = CurveToPolyline(Curve=crv, ToleranceDistance=number_slider_3, ToleranceAngle=number_slider_3)  # -> Polyline, Segments
panel_5 = Panel(crv)
bh = Data(simplify(flatten(subtraction)))
bh_2 = Data(simplify(flatten(item_2.Item)))
Z = UnitZ(Factor=bh_2)
merge = Merge(Data1="DECONSTRUCT EXTRUSION", Data2=panel, Data3=panel_2, Data4=panel_3, Data5=panel_4)
move = Move(Geometry=flatten(topoly.Polyline), Motion=Z)  # -> Geometry, Transform
doc = Text(merge)
doc_2 = ClusterOutput(doc)
panel_6 = Panel(doc)

# ---- group: Cluster Output
bh_3 = ClusterOutput(bh)

# ----
bh_4 = ClusterOutput(bh_2)
G = ClusterOutput(move.Geometry)

# ==== cluster PolygonToGeoJSON11: Writes a polygon to a GeoJSON file, where keys and values can be defined.
P = ClusterInput()
P_2 = Curve(P)
cp = ControlPoints(Curve=P_2)  # -> simplify(Points), Weights, Knots
V = ClusterInput()
K = ClusterInput()
V_2 = Data(simplify(V))
points_to_coordinates = PointsToCoordinates(P=cp.Points)
K_2 = Text(simplify(K))
clean = CleanTree(RemoveNulls=True, RemoveInvalid=True, RemoveEmpty=True, Tree=V_2)
viewer = ParamViewer(clean)
flip = FlipMatrix(Data=clean)
graft = GraftTree(Tree=K_2, IncludeEmptyLists=True, IncludeNullItems=True)  # -> simplify(Tree)
viewer_2 = ParamViewer(graft)
short = ShortestList(ListA=viewer_2, ListB=viewer, TrimMode=2)  # -> ListA, ListB
lng = ListLength(List=flatten(short.ListB))
series = Series(Start=0, Step=1, Count=lng)
item = ListItem(List=viewer_2, Index=series, Wrap=False)
flip_2 = FlipMatrix(Data=flip)
branch = TreeBranch(Tree=graft, Path=item, MaintainPaths=True)
clean_2 = CleanTree(RemoveNulls=True, RemoveInvalid=True, RemoveEmpty=True, Tree=branch)
flatten = FlattenTree(Tree=clean_2, Path="{0}")
rep = ReplaceText(Text="\"█\"", Find="█", Replace=flatten, RecursiveReplace=False)  # -> flatten(Result)
series_2 = Series(Start=0, Step=1, Count=lng)
mindex = MemberIndex(Set=rep, Member="\"height\"")  # -> Index, Count
rep_2 = ReplaceText(Text="{ \"type\": \"Polygon\",█}", Find="█", Replace=points_to_coordinates, RecursiveReplace=False)

# ---- group: Polygon
flatten_2 = FlattenTree(Tree=rep_2, Path="{0}")

# ----
mindex_2 = MemberIndex(Set=rep, Member="\"base_height\"")  # -> Index, Count
panel = Panel("Writes a polygon to a GeoJSON file, where keys and values can be defined. ")
panel_2 = Panel("""OUTPUTS:

GeoJSON (J) - Produces a GeoJSON Feature Collection.""")
panel_3 = Panel(""" 
INPUTS: 

Polyline Curve (P) - Polygon or list of polygons to convert to GeoJSON.

Key (K)- Properties used to describe geometry. To specify height, base height and colour, use the following keys: 

height
base_height
colour 

Value (V) - Values of properties. The list should be structured so that the first branch of data is associated with the first key. This allows unique values to be associated with multiple polygons. """)
panel_4 = Panel("For more documentation visit: github.com/madeleinejohanson/Humpback")
rep_3 = ReplaceText(Text="{\"type\":\"Feature\",\"geometry\":█", Find="█", Replace=flatten_2, RecursiveReplace=False)
merge = Merge(Data1="POLYGON TO GEOJSON", Data2=panel, Data3=panel_3, Data6=panel_2, Data7=panel_4)
doc = Text(merge)
doc_2 = ClusterOutput(doc)
panel_5 = Panel(doc)

# ---- group: Keeps lists consistent lengths, repeating the last value for the total amount of keys
null = NullItem(Item=flip)  # -> NullFlags, InvalidFlags, Description
dispatch = Dispatch(List=flip, DispatchPattern=null.NullFlags)  # -> ListA, ListB
nullrep = ReplaceNulls(Items=flip, Replacements="█")  # -> Items, Count
index = ItemIndex(List=dispatch.ListB, Item=dispatch.ListB)
item_2 = ListItem(List=flip, Index=index, Wrap=True)
mindex_3 = MemberIndex(Set=nullrep.Items, Member="█")  # -> Index, Count
flip_3 = FlipMatrix(Data=item_2)
clean_3 = CleanTree(RemoveNulls=True, RemoveInvalid=True, RemoveEmpty=False, Tree=flip_3)
item_3 = ListItem(List=clean_3, Index=0, Wrap=True)  # -> flatten(Item1), Item

# ----
merge_2 = Merge(Data1=flip_3, Data2=flip_2)
clean_4 = CleanTree(RemoveNulls=True, RemoveInvalid=True, RemoveEmpty=False, Tree=merge_2)
item_4 = ListItem(List=clean_4, Index=0, Wrap=True)  # -> flatten(Item1), Item

# ---- group: Keeps lists consistent lengths, repeating the last value for the total amount of keys (continued)
item_5 = ListItem(List=item_4.Item1, Index=mindex_3.Index, Wrap=True)
replace = ReplaceItems(List=nullrep.Items, Item=item_5, Indices=mindex_3.Index, Wrap=False)

# ----
flip_4 = FlipMatrix(Data=replace)
viewer_3 = ParamViewer(flip_4)
item_6 = ListItem(List=viewer_3, Index=series_2, Wrap=True)

# ---- group: Keeps lists consistent lengths, repeating the last value for the total amount of keys (continued)
branch_2 = TreeBranch(Tree=flip_4, Path=item_6, MaintainPaths=True)  # -> simplify(Branch)

# ----
flip_5 = FlipMatrix(Data=branch_2)

# ---- group: height
item_7 = ListItem(List=flip_5, Index=mindex.Index, Wrap=True)

# ---- group: base_height
item_8 = ListItem(List=flip_5, Index=mindex_2.Index, Wrap=True)

# ----
addition = Addition(A=item_7, B=item_8)
replace_2 = ReplaceItems(List=simplify(flip_5), Item=addition, Indices=mindex.Index, Wrap=False)  # -> simplify(List)
clean_5 = CleanTree(RemoveNulls=True, RemoveInvalid=True, RemoveEmpty=True, Tree=replace_2)
key_value = KeyValue(K=clean_2, V=clean_5)
rep_4 = ReplaceText(Text=",\"properties\":█}", Find="█", Replace=key_value, RecursiveReplace=False)

# ---- group: Feature
concat = Concatenate(FragmentA=rep_3, FragmentB=rep_4)  # -> flatten(Result)

# ----
join = TextJoin(Text=concat, Join=",")
panel_6 = Panel(key_value)
rep_5 = ReplaceText(Text="{\"type\":\"FeatureCollection\",\"features\":[█]}", Find="█", Replace=join, RecursiveReplace=False)
J = Text(rep_5)
J_2 = ClusterOutput(J)

# ==== cluster FileWrite: Exports text to file
content = ClusterInput()
file_path = ClusterInput()
activate = ClusterInput()
T = ClusterInput()
content_2 = Data(content)
file_path_2 = Text(file_path)
join = TextJoin(Text=[file_path_2, T], Join="\")
vb = VBScript(path=simplify(join), lines=simplify(content_2), activate=activate)  # -> out, A
# ---------- vb: VB ----------
    If (activate = True)
      
      system.IO.File.WriteAllText(path, lines)
      A = "File written"
    Else
      A = "Not activated"
    End If
# ---------- end vb ----------

# ==== cluster PointsToCoordinates
P = ClusterInput()
number_slider = Slider(100042, range=0..1000000)
pt2num = PointsToNumbers(Points=graft(P), Mask=4)
number_slider_2 = Slider(1000404, range=0..10000000)
division = Division(A=pt2num, B=Slider(100000, range=0..100000))
expression = Expression(x=division, Expression="format(\"{0}\",x)")
int = Integer(99960)
item = ListItem(List=expression, Index=0, Wrap=True)  # -> Item, Item1, Item2
panel = Panel(pt2num)
num = Number(item.Item2)  # disabled
merge = Merge(Data1=item.Item, Data2=item.Item1, Data3=num)
panel_2 = Panel(division)
wrapper = Wrapper(wrap="[", content=merge, join=",")  # -> simplify(wrapped)
utrim = UberTrim(data=wrapper, bool=Toggle(True))
wrapper_2 = Wrapper(wrap="[", content=utrim, join=",")
rep = ReplaceText(Text="\"coordinates\": [█]", Find="█", Replace=wrapper_2, RecursiveReplace=False)  # -> simplify(Result)
R = ClusterOutput(rep)

# ==== cluster KeyValue
K = ClusterInput()
V = ClusterInput()
K_2 = Text(simplify(K))
V_2 = Data(simplify(V))

# ---- group: HUMPBACK 1.1 Treats numbers as numbers instead of strings
int = Integer(V_2)
null = NullItem(Item=int)  # -> NullFlags, InvalidFlags, Description
panel = Panel("""█
"█"
""")
item = ListItem(List=panel, Index=null.NullFlags, Wrap=True)
rep = ReplaceText(Text=item, Find="█", Replace=V_2, RecursiveReplace=False)

# ----
panel_2 = Panel(K_2)
rep_2 = ReplaceText(Text="\"█\"", Find="█", Replace=K_2, RecursiveReplace=False)  # -> simplify(Result)
panel_3 = Panel("\"█\"")  # disabled
panel_4 = Panel("█")  # disabled
rep_3 = ReplaceText(Text=panel_3, Find=panel_4, Replace=V_2, RecursiveReplace=False)  # disabled
flip = FlipMatrix(Data=rep)  # -> simplify(Data)
lng = ListLength(List=flatten(rep_2))
viewer = ParamViewer(flip)
series = Series(Start=0, Step=1, Count=lng)
item_2 = ListItem(List=viewer, Index=series, Wrap=True)
branch = TreeBranch(Tree=simplify(flip), Path=simplify(item_2), MaintainPaths=True)
long = LongestList(ListA=rep_2, ListB=branch, PaddingMode=2)  # -> ListA, ListB
merge = Merge(Data1=graft(long.ListA), Data2=graft(long.ListB))
join = TextJoin(Text=merge, Join=":")
trim = TrimTree(Tree=join, Depth=1)
flip_2 = FlipMatrix(Data=trim)
join_2 = TextJoin(Text=flip_2, Join=",")
rep_4 = ReplaceText(Text="{█}", Find="█", Replace=join_2, RecursiveReplace=False)  # -> flatten(Result)
J = Text(rep_4)
J_2 = ClusterOutput(J)

# ==== cluster UberTrim: Better version of Trim
data = ClusterInput()
bool = ClusterInput()
data_2 = Data(data)
trim = TrimTree(Tree=data_2, Depth=1)
null = NullItem(Item=trim)  # -> NullFlags, InvalidFlags, Description
dispatch = Dispatch(List=data_2, DispatchPattern=null.NullFlags)  # -> ListA, ListB
bool_2 = Boolean(bool)
trim_2 = TrimTree(Tree=dispatch.ListB, Depth=1)
bool_3 = Boolean(invert(null.NullFlags))
flatten = FlattenTree(Tree=dispatch.ListA, Path="{0}")
merge = Merge(Data1=flatten, Data2=trim_2)
panel = Panel(null.NullFlags)
trim_3 = TrimTree(Tree=data_2, Depth=bool_3)
bool_4 = Boolean(invert(bool_2))
data_3 = Data(trim_3)
dispatch_2 = Dispatch(List=merge, DispatchPattern=bool_4)  # -> ListA, ListB
dispatch_3 = Dispatch(List=data_3, DispatchPattern=bool_2)  # -> ListA, ListB
clean = CleanTree(RemoveNulls=True, RemoveInvalid=True, RemoveEmpty=True, Tree=dispatch_3.ListB)
clean_2 = CleanTree(RemoveNulls=True, RemoveInvalid=True, RemoveEmpty=True, Tree=dispatch_2.ListB)
merge_2 = Merge(Data1=clean, Data2=clean_2)
R = ClusterOutput(merge_2)
panel_2 = Panel(merge_2)

# ==== cluster Wrapper: Wraps data with a wrapping character
join = ClusterInput()  # Join character
content = ClusterInput()  # Content to be wrapped
wrap = ClusterInput()  # Wrap character or XML tag
txt = Text(join)
null = NullItem(Item=txt)  # -> NullFlags, InvalidFlags, Description
data = Data(content)
tmatch = MatchText(Text=wrap, RegEx="<*.>", Case=True)
bool = Boolean(null.NullFlags)
dispatch = Dispatch(List=data, DispatchPattern=bool)  # -> ListA, ListB
item = ListItem(List=wrap, Index=0, Wrap=True)
split = TextSplit(Text=item, Separators=" ")
join_2 = TextJoin(Text=dispatch.ListB, Join=txt)
panel = Panel("""{
[
(
"
'""")
panel_2 = Panel("""{█}
[█]
(█)
"█"
'█'""")
item_2 = ListItem(List=split, Index=0, Wrap=True)
weave = Weave(Pattern=bool, Stream0=join_2, Stream1=dispatch.ListA, NullGaps=False)
data_2 = Data(wrap)
replace = ReplaceMembers(Set=data_2, Find=panel, Replace=panel_2)
rep = ReplaceText(Text=item_2, Find="<", Replace="</", RecursiveReplace=False)
expression = Expression(x=item, y=rep, Expression="Format(\"{0}█{1}>\", x, y)")
rep_2 = ReplaceText(Text=expression, Find=">>", Replace=">", RecursiveReplace=False)
weave_2 = Weave(Pattern=tmatch, Stream0=replace, Stream1=rep_2, NullGaps=False)
rep_3 = ReplaceText(Text=weave_2, Find="█", Replace=weave, RecursiveReplace=False)
data_3 = Data(rep_3)
wrapped = ClusterOutput(data_3)  # Wrapped Output
